% Simulink data dictionary AppSoftware.sldd

MaxMotorCurrent = Simulink.Parameter(8000, StorageClass="Const", DataType="single", Min=0, Max=10000, Unit="mA")
MinMotorCurrent = Simulink.Parameter(100, StorageClass="ConstVolatile", DataType="single", Min=0, Max=10000, Unit="mA")
DebounceStepsToSetMinimumCurrError = Simulink.Parameter(3, StorageClass="Const", DataType="uint8", Min=0, Max=100)
AmbientLightOnTime_C = Simulink.Parameter(18000, StorageClass="Const", DataType="uint16", Min=0, Max=65000)
AmbientLightRequest_sig = Simulink.Signal(StorageClass="ExportedGlobal", DataType="boolean")
HBridgeFailureCode_sig = Simulink.Signal(DataType="boolean")
MotorCurrentADCRawValue_sig = Simulink.Signal(DataType="uint16")
MotorDirection_sig = Simulink.Signal(StorageClass="ExportedGlobal", DataType="boolean")
MotorRotationRequest_sig = Simulink.Signal(StorageClass="ExportedGlobal", DataType="boolean")
MotorSpdUserRequest_sig = Simulink.Signal(DataType="uint16")
StartStopUserRequest_sig = Simulink.Signal(StorageClass="ImportFromFile", HeaderFile="interfaces.h", DataType="boolean")